# Dynamo graph Corte de solidos.dyn (Dynamo 2.13.1.3887)

solido = ObjectSelection()  # 1 picked in the model; graph input
alineamiento = ObjectSelection()  # 1 picked in the model; graph input
name = Autodesk.Civil.DynamoNodes.CivilObject.Name(civilObject=alineamiento)
current = Autodesk.AutoCAD.DynamoNodes.Document.Current()
alignmentByName = Autodesk.Civil.DynamoNodes.Selection.AlignmentByName(name=name, document=current)
intervalo_de_corte = DoubleInput(20)  # graph input
stations = Autodesk.Civil.DynamoNodes.Alignment.Stations(alignment=alignmentByName, interval=intervalo_de_corte)
code_block = CodeBlock { 0; }
coordinateSystemByStationOffset = Autodesk.Civil.DynamoNodes.Alignment.CoordinateSystemByStationOffset(alignment=alignmentByName, station=stations, offset=code_block)
python_script = Python(IN[0]=coordinateSystemByStationOffset)  # CPython3; unwired: IN[1]
# ---------- python_script.python (31 lines) ----------
# Load the Python Standard and DesignScript Libraries
import sys
import clr

# Add Assemblies for AutoCAD and Civil3D
clr.AddReference('AcMgd')
clr.AddReference('AcCoreMgd')
clr.AddReference('AcDbMgd')
clr.AddReference('AecBaseMgd')
clr.AddReference('AecPropDataMgd')
clr.AddReference('AeccDbMgd')

# Import references from AutoCAD
from Autodesk.AutoCAD.Runtime import *
from Autodesk.AutoCAD.ApplicationServices import *
from Autodesk.AutoCAD.EditorInput import *
from Autodesk.AutoCAD.DatabaseServices import *
from Autodesk.AutoCAD.Geometry import *

# Import references from Civil3D
from Autodesk.Civil.ApplicationServices import *
from Autodesk.Civil.DatabaseServices import *

# The inputs to this node will be stored as a list in the IN variables.
list = IN[0]


#list = UnwarpElement(list)


OUT = list
# ----------------------------------------
byCartesianCoordinates = Point.ByCartesianCoordinates(coordinateSystem=python_script)
code_block_2 = CodeBlock { 1; }
coordinateSystemByStationOffset_2 = Autodesk.Civil.DynamoNodes.Alignment.CoordinateSystemByStationOffset(alignment=alignmentByName, station=stations, offset=code_block_2)
byCartesianCoordinates_2 = Point.ByCartesianCoordinates(coordinateSystem=coordinateSystemByStationOffset_2)
number = DoubleInput(1)
byCartesianCoordinates_3 = Point.ByCartesianCoordinates(coordinateSystem=coordinateSystemByStationOffset, z=number)
byThreePoints = Plane.ByThreePoints(origin=byCartesianCoordinates, planePoint=byCartesianCoordinates_2, xAxisPoint=byCartesianCoordinates_3)
sliceByPlanes = Autodesk.AutoCAD.DynamoNodes.Solid.SliceByPlanes(solid=solido, planes=byThreePoints)
byTwoPoints = Vector.ByTwoPoints(start=byCartesianCoordinates, end=byCartesianCoordinates_2)
byOriginNormal = Plane.ByOriginNormal(origin=byCartesianCoordinates_3, normal=byTwoPoints)
watch = Watch(coordinateSystemByStationOffset_2)
surfaces = Surfaces(document=current)
sliceByPlanes_2 = Autodesk.AutoCAD.DynamoNodes.Solid.SliceByPlanes(solid=surfaces, planes=byThreePoints)
